# Dynamo graph DesignScript.dyn (Dynamo 2.10.1.3976)

# group: Design Script
boolean = BoolSelector(true)
python_script = Python(IN[0]=boolean)  # IronPython2
# ---------- python_script.python (3 lines) ----------
f = open(r"U:\17_TraningAdvanceDynamo\2_WORKING\Tool\Dynamo\Traning-Dynamo-2024\DesignScript.py", "r")

OUT = f.read() 
# ----------------------------------------
python_script_from_string = PythonStringNode(script=python_script)  # IronPython2; unwired: IN[0], IN[1]

boolean_2 = BoolSelector(false)
code_block = CodeBlock { [1,2,3,4,5,6,7,8,9,10,11,12]; }  # frozen
byCoordinates = Point.ByCoordinates(x=code_block)
python_script_2 = Python(IN[0]=boolean_2, IN[1]=byCoordinates)  # IronPython2
# ---------- python_script_2.python (8 lines) ----------
items = IN[1]

result = []
for num in range(0,len(items), 1):
	if num % 2:
		result.append(items[num])

OUT = result
# ----------------------------------------
count = List.Count(list=byCoordinates)
code_block_2 = CodeBlock(len=count) { [0..len-1..2]; }
getItemAtIndex = List.GetItemAtIndex(list=byCoordinates, index=code_block_2)
code_block_3 = CodeBlock(a=getItemAtIndex) { a[0]; }
code_block_4 = CodeBlock { 1; }
dropItems = List.DropItems(list=code_block_3, amount=code_block_4)
code_block_5 = CodeBlock { 2; }
byCoordinates_2 = Point.ByCoordinates(x=code_block, y=code_block_5)
count_2 = List.Count(list=byCoordinates_2)
code_block_6 = CodeBlock(len=count_2) { [1..len-1..2]; }
getItemAtIndex_2 = List.GetItemAtIndex(list=byCoordinates_2, index=code_block_6)
code_block_7 = CodeBlock(a=getItemAtIndex_2) { a[0]; }
byStartPointEndPoint = Line.ByStartPointEndPoint(startPoint=dropItems, endPoint=code_block_7)
byStartPointEndPoint_2 = Line.ByStartPointEndPoint(startPoint=getItemAtIndex, endPoint=getItemAtIndex_2)
code_block_8 = CodeBlock { [1,2,3,4,5,6,7,8,9,10,11,12]; }
byCoordinates_3 = CodeBlock(t1=code_block_8) { point1 = Point.ByCoordinates(t1, 0, 0); }
selectEvenPoints = Python(IN[1]=byCoordinates_3)  # IronPython2; unwired: IN[0]
# ---------- selectEvenPoints.python (8 lines) ----------
items = IN[1]

result = []
for num in range(0,len(items), 1):
	if not num % 2:
		result.append(items[num])

OUT = result
# ----------------------------------------
dropItemList = Python(IN[0]=selectEvenPoints)  # IronPython2
# ---------- dropItemList.python (1 lines) ----------
OUT = IN[0][1:]
# ----------------------------------------
byCoordinates_4 = CodeBlock(t1=code_block_8) { point1 = Point.ByCoordinates(t1, 2, 0); }
selectOldPoints = Python(IN[1]=byCoordinates_4)  # IronPython2; unwired: IN[0]; same code as python_script_2
byStartPointEndPoint_3 = CodeBlock(t1=dropItemList, t2=selectOldPoints) { line1 = Line.ByStartPointEndPoint(t1, t2); }
byStartPointEndPoint_4 = CodeBlock(t1=selectEvenPoints, t2=selectOldPoints) { line1 = Line.ByStartPointEndPoint(t1, t2); }
boolean_3 = BoolSelector(false)  # frozen
python_script_3 = Python(IN[0]=boolean_3)  # IronPython2
# ---------- python_script_3.python (59 lines) ----------
import clr
import System
import math 
from System.Collections.Generic import *

clr.AddReference("ProtoGeometry")
from Autodesk.DesignScript.Geometry import *

clr.AddReference('RevitAPI')
import Autodesk
from Autodesk.Revit.DB import *

clr.AddReference('RevitAPIUI')
from Autodesk.Revit.UI import*
from  Autodesk.Revit.UI.Selection import*

clr.AddReference("RevitNodes")
import Revit
clr.ImportExtensions(Revit.Elements)
clr.ImportExtensions(Revit.GeometryConversion)

clr.AddReference("RevitServices")
import RevitServices
from RevitServices.Persistence import DocumentManager
from RevitServices.Transactions import TransactionManager

import clr
clr.AddReference('DSCoreNodes')
from DSCore import *



doc = DocumentManager.Instance.CurrentDBDocument
view = doc.ActiveView
uidoc = DocumentManager.Instance.CurrentUIApplication.ActiveUIDocument
class SelectionFilter(ISelectionFilter):
	def __init__(self, ctgName1 , ctgName2):
		self.ctgName1 = ctgName1
		self.ctgName2 = ctgName2

	def AllowElement(self, element):
		if element.Category.Name == self.ctgName1 or element.Category.Name == self.ctgName2:
			return True
		else:
			return False
	def AllowReference(ref, xyZ):
		return False


ele = SelectionFilter("Grids", "Structural Columns")
elSelectAll = uidoc.Selection.PickElementsByRectangle(ele,"Selects")
OUT = elSelectAll

grids = []
column = []
for i in elSelectAll:
    if i.Category.Name == "Structural Columns": column.append(i)
    if i.Category.Name == "Grids": grids.append(i)
OUT =  column, grids
# ----------------------------------------
