# Dynamo graph DesignScript.dyn (Dynamo 2.10.1.3976)

code_block = CodeBlock { "Z"; }

# group: Design Script
boolean = BoolSelector(false)
python_script = Python(IN[0]=boolean)  # CPython3
# ---------- python_script.python (3 lines) ----------
f = open(r"U:\17_TrainingAdvanceDynamo\2_WORKING\Tool\Dynamo\Traning-Dynamo-2024\DesignScript.py", "r")
#f = open(r"A:\Library-Dynamo-Python-CSharp\test.py", "r")
OUT = f.read() 
# ----------------------------------------
python_script_from_string = PythonStringNode(script=python_script, IN[1]=code_block)  # IronPython2; unwired: IN[0], IN[2]

select_face = DSFaceSelection()  # 1 picked in the model
select_edge = DSEdgeSelection()  # nothing selected
select_model_element = DSModelElementSelection()  # 1 picked in the model
select_model_element_by_category = DSModelElementByCategorySelection()  # nothing selected; nothing selected
boolean_2 = BoolSelector(false)
python_script_2 = Python(IN[0]=boolean_2)  # IronPython2
# ---------- python_script_2.python (49 lines) ----------
"""Copyright(c) 2019 by: duengocnguyen@gmail.com"""
'https://www.youtube.com/channel/UCt2JhCDDFxpYho575WTMZ4g'
"""________________Welcome to BIM3DM-DYNAMO API___________________"""
import clr 
import sys
sys.path.append(r'C:\Program Files\Autodesk\Revit 2020\AddIns\DynamoForRevit\IronPython.StdLib.2.7.8')
import math 
from System.Collections.Generic import *

clr.AddReference("ProtoGeometry")
from Autodesk.DesignScript.Geometry import *

clr.AddReference('RevitAPI')
import Autodesk
from Autodesk.Revit.DB import *

clr.AddReference('RevitAPIUI')
from Autodesk.Revit.UI import*
from  Autodesk.Revit.UI.Selection import*

clr.AddReference("RevitNodes")
import Revit
clr.ImportExtensions(Revit.Elements)
clr.ImportExtensions(Revit.GeometryConversion)

clr.AddReference("RevitServices")
import RevitServices
from RevitServices.Persistence import DocumentManager

from RevitServices.Transactions import TransactionManager

doc = DocumentManager.Instance.CurrentDBDocument
view = doc.ActiveView
uidoc = DocumentManager.Instance.CurrentUIApplication.ActiveUIDocument

#Preparing input from dynamo to revit

objType =  ObjectType.Element



selectedRef =  uidoc.Selection.PickObject(objType)


elementId = selectedRef.ElementId

selectedElement = doc.GetElement(elementId)

OUT = selectedElement, elementId
# ----------------------------------------
